% Simulink design studies MC1.1.mldatx for model TOAD_Simulation

study "MonteCarlo_v0.2": 100 simulations (not selected)
  combinatorial set (100 points):
    sequential set "Parameter Set_1" (100 points):
      "Inertia": Variable(Name=J_d), values J_d_vals (100 points)
      "Lever Arm": Variable(Name=TB_d), values TB_d_vals (100 points)

study "Att2": 100 simulations
  combinatorial set (100 points):
    sequential set "Parameter Set_1" (100 points):
      "Inertia": Variable(Name=J_d), values J_d_vals (100 points)
      "Lever": Variable(Name=TB_d), values TB_d_vals (100 points)