% Simulink data dictionary Model_Vars.sldd

accelBias = [0.09; 0.09; 0.09]

constantsTOAD = struct(
  m_dry=132.5,
  g=9.80145,
  rTB=1.1,
  J=[50 0 0; 0 50 0; 0 0 15],
  MaxThrust=2446.52,
  MaxMdot=1.3204,
  OF=1,
  OxMass=20.78,
  FuMass=19.79,
  OxHeight=0.377,
  FuHeight=0.495,
  OxRadius=0.146,
  FuRadius=0.146,
  Ox_Z=0.85,
  Fu_Z=1.35,
  m_wet=173.07,
  Q=[1.5e-07 0 0 0 0 0 0 0 0 -1.25e-14 -0 -0 0 0 0 0 0 0
   0 1.5e-07 0 0 0 0 0 0 0 -0 -1.25e-14 -0 0 0 0 0 0 0
   0 0 1.5e-07 0 0 0 0 0 0 -0 -0 -1.25e-14 0 0 0 0 0 0
   0 0 0 4.166667e-10 0 0 1.25e-07 0 0 0 0 0 -2.083333e-20 -0 -0 0 0 0
   0 0 0 0 4.166667e-10 0 0 1.25e-07 0 0 0 0 -0 -2.083333e-20 -0 0 0 0
   0 0 0 0 0 4.166667e-10 0 0 1.25e-07 0 0 0 -0 -0 -2.083333e-20 0 0 0
   0 0 0 1.25e-07 0 0 5e-05 0 0 0 0 0 -1.25e-17 -0 -0 0 0 0
   0 0 0 0 1.25e-07 0 0 5e-05 0 0 0 0 -0 -1.25e-17 -0 0 0 0
   0 0 0 0 0 1.25e-07 0 0 5e-05 0 0 0 -0 -0 -1.25e-17 0 0 0
   -1.25e-14 -0 -0 0 0 0 0 0 0 5e-12 0 0 0 0 0 0 0 0
   -0 -1.25e-14 -0 0 0 0 0 0 0 0 5e-12 0 0 0 0 0 0 0
   -0 -0 -1.25e-14 0 0 0 0 0 0 0 0 5e-12 0 0 0 0 0 0
   0 0 0 -1.25e-17 -0 -0 -2.083333e-20 -0 -0 0 0 0 5.0e-15 0 0 0 0 0
   0 0 0 -0 -1.25e-17 -0 -0 -2.083333e-20 -0 0 0 0 0 5.0e-15 0 0 0 0
   0 0 0 -0 -0 -1.25e-17 -0 -0 -2.083333e-20 0 0 0 0 0 5.0e-15 0 0 0
   0 0 0 0 0 0 0 0 0 0 0 0 0 0 0 5.0e-18 0 0
   0 0 0 0 0 0 0 0 0 0 0 0 0 0 0 0 5.0e-18 0
   0 0 0 0 0 0 0 0 0 0 0 0 0 0 0 0 0 5.0e-18],
  R=[0.06 0 0 0 0 0
   0 0.06 0 0 0 0
   0 0 0.06 0 0 0
   0 0 0 0.002 0 0
   0 0 0 0 0.002 0
   0 0 0 0 0 0.002],
  BSigma=0.05,
  BBias=1.0e-8,
  mag=[0.8660254; 0; -0.5],
  K_Att=[-0.7184854 -4.742433e-16 -4.750454e-15 -0.142865 -8.499168e-18 -5.385391e-15 0.3162278 5.493116e-16 9.090468e-16
   2.359224e-16 -0.7184854 -5.783488e-15 3.469447e-17 -0.142865 -6.143263e-15 -3.84738e-16 0.3162278 7.119785e-16
   5.814964e-17 -6.944451e-17 8.768973 1.21866e-16 6.347037e-16 11.64175 -4.315494e-16 9.180308e-16 -1.581139])

distMode = 0
dt = 0.005
dt_SIM = 0.004
gyroBias = [0.05; 0.05; 0.05]
IMU_Rate = 1000
J_d = repmat(0, 3, 3)
magDistMatrix = [1 0 0; 0 1 0; 0 0 1]
MaxMdot_d = 0

slBus1 = Simulink.Bus()
  m_dry: double
  g: double
  rTB: double
  J: double[3 3]
  MaxThrust: double
  MaxMdot: double
  OF: double
  OxMass: double
  FuMass: double
  OxHeight: double
  FuHeight: double
  OxRadius: double
  FuRadius: double
  Ox_Z: double
  Fu_Z: double
  m_wet: double
  Q: double[18 18]
  R: double[6 6]
  BSigma: double
  BBias: double
  mag: double[3 1]
  K_Att: double[3 9]

TB_d = [0; 0; 0]
u0 = [0; 0; 1696.337; 0]
x0 = [1; 0; 0; 0; 0; 0; 0; 0; 0; 0; 0; 0; 0; 20.78; 19.79]

Waypoints = [struct(
  Position=[0; 0; 0],
  MaxVel=[3; 3; 6],
  VelFF=[0; 0; 0],
  HoldTime=20,
  PosTol=1,
  Label="PAD HLD 1",
  IsPassAndGo=false), struct(
  Position=[0; 0; 5],
  MaxVel=[3; 3; 6],
  VelFF=[0; 0; 6],
  HoldTime=NaN,
  PosTol=3,
  Label="PAD DIV 1",
  IsPassAndGo=true), struct(
  Position=[5; 5; 50],
  MaxVel=[3; 3; 6],
  VelFF=[0; 0; 0],
  HoldTime=10,
  PosTol=1,
  Label="FLT HOV 1",
  IsPassAndGo=false), struct(
  Position=[5; 5; 35],
  MaxVel=[3; 3; 6],
  VelFF=[0; 0; -6],
  HoldTime=NaN,
  PosTol=1,
  Label="FLT DIV 2",
  IsPassAndGo=true), struct(
  Position=[10; 10; 0],
  MaxVel=[3; 3; 6],
  VelFF=[0; 0; 0],
  HoldTime=10,
  PosTol=1,
  Label="FLT END 1",
  IsPassAndGo=false)]

windMerid = 2.29163
windZonal = 4.031552